# Grasshopper definition valve-radiale-respirateur.gh (Grasshopper 1.0.7)

# ----
# Paramètres
taille_extension_raccord = Slider(25, range=0..30)
hauteur_interpolation = Slider(73, range=40..100)
diametre_externe = Panel("30")
epaisseur = Panel("4")
# Valve respirateur radiale COVID-19
branch_number = Panel("2")
diametre_central = Panel("40")

subtraction = Subtraction(A=diametre_externe, B=epaisseur)
division = Division(A=diametre_externe, B="2")
division_2 = Division(A=subtraction, B="2")

# ----
# Radial branching
pt = ConstructPoint(XCoordinate=0, YCoordinate=0, ZCoordinate=0)
division_3 = Division(A=diametre_central, B="2")
cir = Circle(Plane=pt, Radius=division_3)
divide = DivideCurve(Curve=cir, Count=branch_number, Kinks=False)  # -> Points, Tangents, Parameters

# ----
# Angle de rotation
num = Number(branch_number)
expression = Expression(x=num, Expression="(2 * pi) / x")
series = Series(Start=0, Step=1, Count=num)
multiplication = Multiplication(A=series, B=expression)

# ----
# Interpolation
hauteur_fin_interpolation = Panel("1")
num_2 = Number(hauteur_interpolation)
addition = Addition(A=num_2, B=hauteur_fin_interpolation)
neg = Negative(Value=hauteur_fin_interpolation)
pt_2 = ConstructPoint(XCoordinate=0, YCoordinate=0, ZCoordinate=0)
Z = UnitZ(Factor=neg)
item = ListItem(List=divide.Points, Index=0, Wrap=True)
item_2 = ListItem(List=divide.Points, Index=0, Wrap=True)
Z_2 = UnitZ(Factor=num_2)
Z_3 = UnitZ(Factor=addition)
move = Move(Geometry=item, Motion=Z_2)  # -> Geometry, Transform
move_2 = Move(Geometry=item_2, Motion=Z_3)  # -> Geometry, Transform
move_3 = Move(Geometry=pt_2, Motion=Z)  # -> Geometry, Transform
merge = Merge(Data1=move_3.Geometry, Data2=pt_2, Data3=move.Geometry, Data4=move_2.Geometry)  # -> flatten(Result)
intcrv = Interpolate(Vertices=merge, Degree=3, Periodic=False, KnotStyle=1)  # -> Curve, Length, Domain

num_3 = Number(taille_extension_raccord)

# ----
# Extensions entrées - sorties
end = EndPoints(Curve=intcrv.Curve)  # -> Start, End
neg_2 = Negative(Value=num_3)
Z_4 = UnitZ(Factor=neg_2)
Z_5 = UnitZ(Factor=num_3)
move_4 = Move(Geometry=end.End, Motion=Z_5)  # -> Geometry, Transform
move_5 = Move(Geometry=end.Start, Motion=Z_4)  # -> Geometry, Transform
ln = Line(StartPoint=end.Start, EndPoint=move_5.Geometry)
ln_2 = Line(StartPoint=end.End, EndPoint=move_4.Geometry)
merge_2 = Merge(Data1=ln, Data2=intcrv.Curve, Data3=ln_2)
join = JoinCurves(Curves=merge_2, Preserve=False)

num_4 = Number(multiplication)

X = UnitX(Factor=Slider(0.1, range=0..1))

# ----
# Creation du solide
num_5 = Number(division)
pipe = Pipe(Curve=join, Radius=num_5, Caps=1)
move_6 = Move(Geometry=pipe, Motion=X)  # -> Geometry, Transform
rotate = Rotate(Geometry=move_6.Geometry, Angle=num_4, Plane=PlaneXY(0, 0, 0))  # -> Geometry, Transform
sunion = SolidUnion(Breps=rotate.Geometry)

# ----
# Creation du solide interne
num_6 = Number(division_2)
pipe_2 = Pipe(Curve=join, Radius=num_6, Caps=1)
move_7 = Move(Geometry=pipe_2, Motion=X)  # -> Geometry, Transform
rotate_2 = Rotate(Geometry=move_7.Geometry, Angle=num_4, Plane=PlaneXY(0, 0, 0))  # -> Geometry, Transform
sunion_2 = SolidUnion(Breps=rotate_2.Geometry)

# ----
# Solid difference
sdiff = SolidDifference(BrepsA=sunion, BrepsB=sunion_2)

# ----
# Render
material = CreateMaterial(Diffuse=RGB(255, 105, 180), Specular=RGB(255, 255, 255), Emission=RGB(0, 0, 0), Transparency=0, Shine=0)
preview = CustomPreview(Geometry=sdiff, Material=material)
